# Grasshopper definition animation_piton.ghx (Grasshopper 1.0.7)
# plug-ins: Human

# ---- group: Application Control
# Application Control : Control simulation running or not
# Initial Param : Get initial param from .3dm to be used in grasshopper
# Select Active Agent Form : Dialog box for select active agent, speed & number of simulation days
# Initializer : Initializer grid for agent movement, house, and active agent
# Delta Time : Calculate delta time in miliseconds for each frame
# ABM Updater : Update simulation (house, timer, agent, etc) state for each frame
# Anim Processor : Update and draw agent icon based on calculation at ABM Updater
# Activity Form : Dialog box showing current activity for each agent and energy usage
reset = BooleanToggle(True)
appcontrol = GhPythonScript(reset=reset)  # -> reset; inputs reset: Boolean
# ---------- appcontrol: Python ----------
from ghpythonlib.componentbase import executingcomponent as component
import Grasshopper, GhPython
import System
import Rhino
import rhinoscriptsyntax as rs
import scriptcontext as sc
import time

class MyComponent(component):
    
    def RunScript(self, reset):
        """Provides a scripting component.
            Inputs:
                x: The x script variable
                y: The y script variable
            Output:
                a: The a output variable"""
        
        __author__ = "remote"
        __version__ = "2020.08.05"
        if reset:
            sc.sticky["AgentActivationDone"] = False
        
        import rhinoscriptsyntax as rs
        print sc.sticky["AgentActivationDone"]
        print reset
        sc.sticky["StartFrame"] = int(time.time()*1000)
        # return outputs if you have them; here I try it for you:
        return (reset or not sc.sticky["AgentActivationDone"])
# ---------- end appcontrol ----------

# ----
timer = Timer(TimerInterval=10, Target=appcontrol)

# ---- group: Delta Time
c_script = CSharpScript(reset=appcontrol)  # -> out, deltaTime; inputs reset: Boolean
# ---------- c_script: C# usings ----------
using System.IO;
using System.Linq;
using System.Data;
using System.Drawing;
using System.Reflection;
using System.Windows.Forms;
using System.Xml;
using System.Xml.Linq;
using System.Runtime.InteropServices;

using Rhino.DocObjects;
using Rhino.Collections;
using GH_IO;
using GH_IO.Serialization;
# ---------- c_script: C# ----------
    if(oldTime == DateTime.MinValue)
    {
      deltaTime = 0;
    }
    else
    {
      deltaTime = (DateTime.Now - oldTime).TotalMilliseconds;
    }
    oldTime = DateTime.Now;
# ---------- c_script: C# additional code ----------
  DateTime oldTime = DateTime.MinValue;
# ---------- end c_script ----------

# ---- group: Initial Param
python = GhPythonScript()  # -> initial_location
# ---------- python: Python ----------
from ghpythonlib.componentbase import executingcomponent as component
import Grasshopper, GhPython
import System
import Rhino as rh
import rhinoscriptsyntax as rs
from Rhino.Geometry import Point3d

class MyComponent(component):
    def __init__(self):
        self.m_startPoint = []
    
    def RunScript(self, ):
        """Provides a scripting component.
            Inputs:
                x: The x script variable
                y: The y script variable
            Output:
                a: The a output variable"""
        
        __author__ = "remote"
        __version__ = "2020.09.29"
        
        import rhinoscriptsyntax as rs
        if len(self.m_startPoint) == 0:
            obj = rh.RhinoDoc.ActiveDoc.Objects.FindByLayer("START_POINT")
            self.m_startPoint = [None] * len(obj)
            for o in obj:
                index = int(rs.GetUserText(o,"StartPoint"))
                self.m_startPoint[index] = o
        # return outputs if you have them; here I try it for you:
        return self.m_startPoint
# ---------- end python ----------
python_2 = GhPythonScript()  # -> area, mapName
# ---------- python_2: Python ----------
from ghpythonlib.componentbase import executingcomponent as component
import Grasshopper, GhPython
import System
import Rhino as rh
import rhinoscriptsyntax as rs
from Rhino.Geometry import Rectangle3d

class MyComponent(component):
    def __init__(self):
        self.m_area = []
        self.m_mapName = ""
    
    def RunScript(self, ):
        """Provides a scripting component.
            Inputs:
                x: The x script variable
                y: The y script variable
            Output:
                a: The a output variable"""
        
        __author__ = "remote"
        __version__ = "2020.09.29"
        
        import rhinoscriptsyntax as rs
        if len(self.m_area) == 0:
            obj = rh.RhinoDoc.ActiveDoc.Objects.FindByLayer("AREA_LIMIT")
            self.m_area = [None] * len(obj)
            print(len(obj))
            for ob in obj:
                pl = ob.Geometry.ToPolyline()
                rect = Rectangle3d(rh.Geometry.Plane.WorldXY,pl[0],pl[2])
                floor = int(rs.GetUserText(ob,"AreaLimit"))
                self.m_area[floor] = rect
                self.m_mapName = rs.GetUserText(ob,"MapName")
        # return outputs if you have them; here I try it for you:
        print(self.m_mapName)
        return self.m_area,self.m_mapName
# ---------- end python_2 ----------

# ---- group: Select Active Agent Form
agentactiveform = GhPythonScript(Frame=c_script.deltaTime, mapName=python_2.mapName, Locations=python, Reset=reset)  # -> ActiveAgent, retSurface, retImg; inputs Locations: list, Reset: Boolean
# ---------- agentactiveform: Python ----------
from ghpythonlib.componentbase import executingcomponent as component
import Grasshopper, GhPython
import System
import Rhino
import rhinoscriptsyntax as rs
import sys
from Rhino.Geometry import NurbsSurface, Point3d
import scriptcontext as sc

import Rhino.UI
import Eto.Drawing as drawing
import Eto.Forms as forms

class AgentActivator(forms.Form):
    def __init__(self):
        cFPath = ghenv.Component.OnPingDocument().FilePath
        cpath = cFPath[0:cFPath.rfind('\\')+1]
        self.m_imgPath = []
        self.m_imgPath.append(cpath+'..\\res\\m5.png')
        self.m_imgPath.append(cpath+'..\\res\\w3.png')
        self.m_imgPath.append(cpath+'..\\res\\m2.png')
        self.m_imgPath.append(cpath+'..\\res\\w1.png')
        self.m_imgPath.append(cpath+'..\\res\\m4.png')
        self.m_imgPath.append(cpath+'..\\res\\w2.png')
        self.m_imgPath.append(cpath+'..\\res\\m6.png')
        self.m_imgPath.append(cpath+'..\\res\\w4.png')
        
        self.m_names = []
        self.m_names.append("agen01")
        self.m_names.append("agen02")
        self.m_names.append("agen03")
        self.m_names.append("agen04")
        self.m_names.append("agen05")
        self.m_names.append("agen06")
        self.m_names.append("agen07")
        self.m_names.append("agen08")
        
        self.m_ticks = []
        
        self.Title = "Choosa Active Agent"
        self.Padding = drawing.Padding(10)
        
        self.m_layout = forms.DynamicLayout()
        self.m_layout.Spacing = drawing.Size(5,5)
        self.m_layout.Padding = drawing.Padding(10)
        
        layoutDay = forms.DynamicLayout()
        layoutDay.Spacing = drawing.Size(5,5)
        layoutDay.Padding = drawing.Padding(10)
        
        self.m_numberDayDropDown = forms.DropDown()
        for i in range(1,31):
            self.m_numberDayDropDown.Items.Add(str(i))
        self.m_numberDayDropDown.SelectedIndex = 0
        layoutDay.AddRow(forms.Label(Text = "Days"), self.m_numberDayDropDown)
        
        layoutSpeed = forms.DynamicLayout()
        layoutSpeed.Spacing = drawing.Size(5,5)
        layoutSpeed.Padding = drawing.Padding(10)
        
        self.m_ScaleSpeedDropDown = forms.DropDown()
        for i in range(1,4):
            self.m_ScaleSpeedDropDown.Items.Add(str(i)+"x")
        self.m_ScaleSpeedDropDown.SelectedIndex = 0
        layoutSpeed.AddRow(forms.Label(Text = "Speed"), self.m_ScaleSpeedDropDown)
        self.m_layout.AddRow(layoutSpeed,layoutDay)
        
        for i in range(0,4):
            layout = forms.DynamicLayout()
            tick = forms.CheckBox()
            self.m_ticks.append(tick)
            personIcon = forms.ImageView()
            personIcon.Size = drawing.Size(50,50)
            personIcon.Image = drawing.Bitmap(self.m_imgPath[i*2])
            name = forms.Label(Text = self.m_names[i*2],HorizontalAlign = forms.HorizontalAlign.Center)
            layout.Spacing = drawing.Size(5,5)
            layout.Padding = drawing.Padding(10)
            layout.AddRow(tick,personIcon)
            layout.AddRow(None,name)
            
            layout2 = forms.DynamicLayout()
            tick = forms.CheckBox()
            self.m_ticks.append(tick)
            personIcon = forms.ImageView()
            personIcon.Size = drawing.Size(50,50)
            personIcon.Image = drawing.Bitmap(self.m_imgPath[(i*2)+1])
            name = forms.Label(Text = self.m_names[(i*2)+1],HorizontalAlign = forms.HorizontalAlign.Center)
            layout2.Spacing = drawing.Size(5,5)
            layout2.Padding = drawing.Padding(10)
            layout2.AddRow(tick,personIcon)
            layout2.AddRow(None,name)
            
            self.m_layout.AddRow(layout,layout2)
        self.DefaultButton = forms.Button(Text = 'OK')
        self.DefaultButton.Click += self.OnOKButtonClick
        self.m_layout.AddRow(self.DefaultButton)
        self.m_layout.AddSpace()
        self.m_shown = False
        self.Shown += self.SetShow
        self.Closed += self.SetClose
        self.Content = self.m_layout
        
    def OnOKButtonClick(self, sender, e):
        self.Close()
    
    def SetShow(self, sender, e):
        self.m_shown = True
        
    def SetClose (self, sender, e):
        self.m_shown = False
        sc.sticky["AgentActivationDone"] = True
        sc.sticky["NumberOfDays"] = self.m_numberDayDropDown.SelectedIndex + 1
        sc.sticky["SimulationSpeed"] = self.m_ScaleSpeedDropDown.SelectedIndex + 1
        
    def AdjustAgentCount(self, amount):
        curShow = 0
        self.m_layout = forms.DynamicLayout()
        self.m_layout.Spacing = drawing.Size(5,5)
        self.m_layout.Padding = drawing.Padding(10)
        self.m_ticks = []
        
        layoutDay = forms.DynamicLayout()
        layoutDay.Spacing = drawing.Size(5,5)
        layoutDay.Padding = drawing.Padding(10)
        
        self.m_numberDayDropDown = forms.DropDown()
        for i in range(1,31):
            self.m_numberDayDropDown.Items.Add(str(i))
        self.m_numberDayDropDown.SelectedIndex = 0
        
        layoutDay.AddRow(forms.Label(Text = "Days"), self.m_numberDayDropDown)
        
        layoutSpeed = forms.DynamicLayout()
        layoutSpeed.Spacing = drawing.Size(5,5)
        layoutSpeed.Padding = drawing.Padding(10)
        
        self.m_ScaleSpeedDropDown = forms.DropDown()
        for i in range(1,4):
            self.m_ScaleSpeedDropDown.Items.Add(str(i)+"x")
        self.m_ScaleSpeedDropDown.SelectedIndex = 0
        layoutSpeed.AddRow(forms.Label(Text = "Speed"), self.m_ScaleSpeedDropDown)
        self.m_layout.AddRow(layoutSpeed,layoutDay)
        
        for i in range(0,4):
            layout = None
            layout2 = None
            if curShow < amount:
                layout = forms.DynamicLayout()
                tick = forms.CheckBox()
                self.m_ticks.append(tick)
                personIcon = forms.ImageView()
                personIcon.Size = drawing.Size(50,50)
                personIcon.Image = drawing.Bitmap(self.m_imgPath[i*2])
                name = forms.Label(Text = self.m_names[i*2],HorizontalAlign = forms.HorizontalAlign.Center)
                layout.Spacing = drawing.Size(5,5)
                layout.Padding = drawing.Padding(10)
                layout.AddRow(tick,personIcon)
                layout.AddRow(None,name)
            
            curShow+=1
            if curShow < amount:            
                layout2 = forms.DynamicLayout()
                tick = forms.CheckBox()
                self.m_ticks.append(tick)
                personIcon = forms.ImageView()
                personIcon.Size = drawing.Size(50,50)
                personIcon.Image = drawing.Bitmap(self.m_imgPath[(i*2)+1])
                name = forms.Label(Text = self.m_names[(i*2)+1],HorizontalAlign = forms.HorizontalAlign.Center)
                layout2.Spacing = drawing.Size(5,5)
                layout2.Padding = drawing.Padding(10)
                layout2.AddRow(tick,personIcon)
                layout2.AddRow(None,name)
            curShow+=1
            self.m_layout.AddRow(layout,layout2)
        self.m_layout.AddRow(self.DefaultButton)
        self.m_layout.AddSpace()
        self.Content = self.m_layout

class MyComponent(component):
    def __init__(self):
        self.m_activeAgent = [False for i in range(0,8)]
        self.m_hasSetup = False
        self.m_show = False
        self.m_dialog = AgentActivator()
        self.m_count = 0
        self.m_surfaces = []
        
    def RunScript(self, Frame, MapName, Locations, Reset):
        UsedLocation = None
        sc.sticky["MapName"] = MapName
        """Provides a scripting component.
            Inputs:
                x: The x script variable
                y: The y script variable
            Output:
                a: The a output variable"""
        
        __author__ = "remote"
        __version__ = "2020.07.27"
        if len(self.m_activeAgent) != len(Locations):
            self.m_hasSetup = False
        import rhinoscriptsyntax as rs
        if  (not Reset) and (not self.m_hasSetup):
            self.m_dialog = AgentActivator()
            self.m_dialog.m_names = []
            for loc in Locations:
                role = rs.GetUserText(loc,"Role")
                self.m_dialog.m_names.append(role)
            self.m_dialog.AdjustAgentCount(len(Locations))
            self.m_activeAgent = [False for i in range(0,len(Locations))]
            print "ajusting "+str(len(Locations))
            self.m_dialog.Show()
            self.m_hasSetup = True
            self.m_show = True
            halfSize = 0.2
            for pLoc in Locations:
                if pLoc != None:
                    loc = pLoc.PointGeometry.Location
                    surface = NurbsSurface.CreateFromCorners(Point3d(loc.X - halfSize,loc.Y-halfSize,0),Point3d(loc.X+halfSize,loc.Y-halfSize,0),Point3d(loc.X+halfSize,loc.Y+halfSize,0),Point3d(loc.X - halfSize,loc.Y+halfSize,0))
                    self.m_surfaces.append(surface)
        elif Reset:
            self.m_hasSetup = False
            self.m_count += 1
            if self.m_show:
                self.m_dialog.Close()
                self.m_show
        # return outputs if you have them; here I try it for you:
        retSurface = []
        retImg = []
        self.m_activeAgent = [tick.Checked for tick in self.m_dialog.m_ticks]
        if self.m_dialog.m_shown:
            print len(self.m_activeAgent)
            for i,isActive in enumerate(self.m_activeAgent):
                if isActive:
                    retSurface.append(self.m_surfaces[i])
                    retImg.append(self.m_dialog.m_imgPath[i])
        
        return self.m_activeAgent,retSurface,retImg
# ---------- end agentactiveform ----------
previewmat = CustomPreviewMaterials(Geometry=agentactiveform.retSurface, DiffuseColor=RGBA(255, 255, 255, 1), DiffuseBitmap=agentactiveform.retImg)

# ---- group: Initializer
gridgenerator = GhPythonScript(reset=appcontrol, area=python_2.area, mapName=python_2.mapName)  # -> gridArea, topPos, additionalWeight, rooms; inputs reset: Boolean, area: list
# ---------- gridgenerator: Python ----------
from ghpythonlib.componentbase import executingcomponent as component
import Grasshopper, GhPython
import System
import Rhino as rh
import rhinoscriptsyntax as rs
import scriptcontext as sc
import math
import csv
import Rhino.Geometry as rg
import sys

from Rhino.Geometry import Point3d,Point,NurbsSurface

cFPath = ghenv.Component.OnPingDocument().FilePath
cpath = cFPath[0:cFPath.rfind('\\')+1]
my_path = cpath+'..\source'
if not my_path in sys.path:
    sys.path.append(my_path)

import Global
Global = reload(Global)
import Target
Target = reload(Target)

import Agent
Agent = reload(Agent)

import EntryPoint
EntryPoint = reload(EntryPoint)

import House
House = reload(House)

import Door
Door = reload(Door)
DIRECTION_CCW = -1
DIRECTION_CW = 1
OFFSET = 0.01

import PathFinding
PathFinding = reload(PathFinding)

import Timer
import Config
Timer = reload(Timer)

STATE_FREE = 0
STATE_BLOCKED = 1
STATE_ENTRY = 2
STATE_BLOCKED_OBJ = 3


class MyComponent(component):
    
    def __init__(self):
        self.NEIGHBOR_CHECK = []
        self.NEIGHBOR_DIS = 2
        self.WALL_DISTANCE = 0.12
        self.gridSize = 0.08
        self.grids = []
        self.gridInitialized = False
        self.topPos = []
        self.possibleTarget = []
        self.entryPoint = []
        self.isRun = False
        self.additionalWeight = []
        self.m_rooms = []
        self.m_doors = []
    
    def GenerateNeighborCheck(self):
        self.NEIGHBOR_CHECK = []
        for i in range(-self.NEIGHBOR_DIS,self.NEIGHBOR_DIS+1):
            for j in range(-self.NEIGHBOR_DIS,self.NEIGHBOR_DIS+1):
                if i == 0 and j == 0:
                    continue
                self.NEIGHBOR_CHECK.append((i,j))
    
    def GenerateRooms(self,objectList,idx):
        sc.doc = rh.RhinoDoc.ActiveDoc
        roomIndex = sc.doc.Layers.Find("ROOM_AREA",True)
        sc.doc = ghdoc
        newRoom = []
        roomCoord = []
        roomCoordGroup = []
        roomGroup = []
        for object in objectList:
            if object.Attributes.LayerIndex == roomIndex:
                if object.GetType() == rh.DocObjects.PointObject:
                    roomCoord.append(object.PointGeometry.Location)
                    roomCoordGroup.append(object.GetGroupList())
                elif object.GetType() == rh.DocObjects.CurveObject:
                    newRoom.append(House.Room(rs.GetUserText(object,"RName"),27,100,object.Geometry,rs.GetUserText(object,"Lamp"), rs.GetUserText(object,"Resource"),idx))
                    rh.Geometry.PointContainment.Inside
                    roomGroup.append(object.GetGroupList())
        Global.Logger.LogDebug("G count "+str(len(roomCoord))+" "+str(len(roomCoordGroup))+"\n")
        i = 0;
        for (coord,rCGroup) in zip(roomCoord,roomCoordGroup):
            Global.Logger.LogDebug("iterate "+str(i))
            i+=1
            paired = False
            Global.Logger.LogDebug("Room coord "+str(coord)+" group "+str(rCGroup)+"\n")
            for g in rCGroup:
                for (room,rGroup) in zip(newRoom,roomGroup):
                    Global.Logger.LogDebug("Room "+room.m_name+" group "+str(rGroup)+"\n")
                    if rGroup == None:
                        continue
                    for rg in rGroup:
                        if g == rg:
                            room.AddTargetCoord(coord)
                            paired = True
                            break
                    if paired:
                        break
                if paired:
                    break
            Global.Logger.LogDebug("end loop\n")
        self.m_rooms.extend(newRoom)
        self.LoadLightAndTemperatureTable()
        Global.Logger.DumpDebug()
    def InitializeGrid(self,area,idx):
        print "InitializeGrid "+str(idx)
        import rhinoscriptsyntax as rs
        self.GenerateNeighborCheck()
        
        sc.doc = rh.RhinoDoc.ActiveDoc
        groundIndex = sc.doc.Layers.Find("ARS-LANTAI",True)
        sc.doc = ghdoc
        
        entryPointObject = []
        targetPointObject = []
        
        #get nurbscurve or rectangle
        rectArea = rs.coercecurve(area)
        
        minX = min(rectArea.Points[0].Location[0],rectArea.Points[2].Location[0])
        maxX = max(rectArea.Points[0].Location[0],rectArea.Points[2].Location[0])
        
        minY = min(rectArea.Points[0].Location[1],rectArea.Points[2].Location[1])
        maxY = max(rectArea.Points[0].Location[1],rectArea.Points[2].Location[1])
        
        #get width/height of the area and gridCount
        gridCountW = abs(int(math.ceil(maxX/self.gridSize)) - int(math.floor(minX/self.gridSize)))
        
        gridCountH = abs(int(math.ceil(maxY/self.gridSize)) - int(math.floor(minY/self.gridSize)))
        
        #initialize grid array
        curGrids = [[STATE_FREE for i in range(gridCountH)]for j in range(gridCountW)]
        curAdditionalWeight = [[0 for i in range(gridCountH)]for j in range(gridCountW)]
        curTargets = []
        curEntries = []
        
        gridStartX = float(math.floor(minX/self.gridSize)) * self.gridSize
        gridStartY = float(math.ceil(maxY/self.gridSize)) * self.gridSize
        
        if rectArea:
            rh.DocObjects.Tables.ObjectTable.UnselectAll(rh.RhinoDoc.ActiveDoc.Objects)
            #get objects inside the region
            rc,pl = rectArea.TryGetPolyline()
            view = sc.doc.Views.ActiveView.ActiveViewport
            objectList = rh.RhinoDoc.ActiveDoc.Objects.FindByCrossingWindowRegion(view,pl,True,rh.DocObjects.ObjectType.AnyObject)#rh.DocObjects.ObjectType.Curve|rh.DocObjects.ObjectType.Point|rh.DocObjects.ObjectType.InstanceDefinition)
            
            doorFrame = {}
            doorPanel = {}
            
            for object in objectList:
                if rs.GetUserText(object,"Type") == "Door":
                    part = rs.GetUserText(object,"Part")
                    id = rs.GetUserText(object, "ID")
                    if part == "Panel":
                        if id in doorPanel.keys():
                            doorPanel[id].append(object)
                        else:
                            doorPanel[id] = [object]
                    elif part == "Frame":
                         if id in doorFrame.keys():
                            doorFrame[id].append(object)
                         else:
                            doorFrame[id] = [object]
                    continue
                
                if object.Attributes.LayerIndex == groundIndex or rs.GetUserText(object,"IgnoreGrid") != None:
                    continue
                
                if object.ObjectType == rh.DocObjects.ObjectType.Point:
                    if rs.GetUserText(object,"Target") != None:
                        type = rs.GetUserText(object,"Type")
                        if type == None:
                            type = "Other"
                        usage = rs.GetUserText(object,"Usage")
                        pUsage = 0 if usage == None else float(usage)
                        active = rs.GetUserText(object,"Active") != None
                        envEffect = rs.GetUserText(object,"EnvEffect")
                        if envEffect == None:
                            envEffect = "-"
                        autoTrigger = rs.GetUserText(object,"Trigger")
                        if autoTrigger == None:
                            autoTrigger = "-"
                        target = Target.Target(idx,type,envEffect,object.PointGeometry.Location,rs.GetUserText(object,"ID"),pUsage, active,autoTrigger)
                        targetPointObject.append(object)
                        specific = rs.GetUserText(object,"Specific")
                        if specific != None:
                            specList = specific.split(',')
                            for spec in specList:
                                target.setSpecificAgent(int(spec))
                        activity = rs.GetUserText(object,"Activity")
                        if activity != None:
                            actList = activity.split(',')
                            for act in actList:
                                target.setActivity(act)
                        curTargets.append(target)
                    if rs.GetUserText(object,"Entry") != None:
                        entryPointObject.append(object)
                        curEntries.append(EntryPoint.EntryPoint(object.PointGeometry.Location,idx))
                    continue
                    
                if object.GetType() == rh.DocObjects.InstanceObject:
                    Global.Logger.LogDebug("geo type "+str(object.Geometry.GetType())+"\n")
                    bbox = object.Geometry.GetBoundingBox(rh.Geometry.Plane.WorldXY)
                    sc.doc = rh.RhinoDoc.ActiveDoc
                    new = rs.CopyObject(object.Id)
                    blockInstanceElements = rs.ExplodeBlockInstance(new,True)
                    curveBlockInstanceElements = []
                    for elm in blockInstanceElements:
                        cv = rs.coercecurve(elm)
                        if cv != None:
                            curveBlockInstanceElements.append(cv)
                    sc.doc=ghdoc
                    Global.Logger.DumpDebug()
                elif object.GetType() == rh.DocObjects.CurveObject:
                    curve = object.CurveGeometry
                    if not curve:
                        continue
                    bbox = curve.GetBoundingBox(True)
                else:
                    continue
                if not bbox.IsValid: continue
                
                xMin = int(((float(math.floor((bbox.Min.X - self.WALL_DISTANCE)/self.gridSize)) * self.gridSize) - gridStartX)/self.gridSize)
                xMax = int(((float(math.ceil((bbox.Max.X + self.WALL_DISTANCE)/self.gridSize)) * self.gridSize) - gridStartX)/self.gridSize)
                yMin = int((gridStartY - (float(math.floor((bbox.Min.Y - self.WALL_DISTANCE)/self.gridSize)) * self.gridSize))/self.gridSize)
                yMax = int((gridStartY - (float(math.ceil((bbox.Max.Y + self.WALL_DISTANCE)/self.gridSize)) * self.gridSize))/self.gridSize)
            
                for i in range(yMax,yMin+1):
                    for j in range(xMin,xMax+1):
                        if i >= gridCountH or j >= gridCountW or i < 0 or j < 0:
                            continue
                        cRect = rh.Geometry.Rectangle3d(rh.Geometry.Plane.WorldXY,rg.Point3d(gridStartX+(j*self.gridSize),gridStartY-(i*self.gridSize),0),rg.Point3d(gridStartX+((j+1)*self.gridSize),gridStartY-((i+1)*self.gridSize),0))
                        if object.GetType() == rh.DocObjects.InstanceObject:
                            for elm in curveBlockInstanceElements:
                                inter = rg.Intersect.Intersection.CurveCurve(elm,cRect.ToNurbsCurve(),self.WALL_DISTANCE,0)
                                if inter:
                                    curGrids[j][i] = STATE_BLOCKED
                        else:
                            inter = rg.Intersect.Intersection.CurveCurve(object.CurveGeometry,cRect.ToNurbsCurve(),self.WALL_DISTANCE,0)
                            if inter:
                                curGrids[j][i] = STATE_BLOCKED
                if object.GetType() == rh.DocObjects.InstanceObject:
                    sc.doc = rh.RhinoDoc.ActiveDoc
                    rs.DeleteObjects(blockInstanceElements)
                    sc.doc=ghdoc
            
            self.GenerateRooms(objectList,idx)
            Global.Logger.LogDebug("doorframe\n"+str(doorFrame)+"\n")
            Global.Logger.LogDebug("doorpanel\n"+str(doorPanel)+"\n")
            for doorFrameId in doorFrame.keys():
                if doorFrameId in doorPanel.keys():
                    frameBoundingBox = rh.Geometry.BoundingBox.Union(doorFrame[doorFrameId][0].Geometry.GetBoundingBox(True),doorFrame[doorFrameId][1].Geometry.GetBoundingBox(True))
                    panels = []
                    for panel in doorPanel[doorFrameId]:
                        rotCenter, rotDir = self.DetermineRotationCenterAndDir(frameBoundingBox,panel)
                        panelTuple = (panel, rotCenter, rotDir)
                        panels.append(panelTuple)
                    
                    frameCorner = frameBoundingBox.GetCorners()
                    
                    isVertical = (frameCorner[2].X - frameCorner[0].X < frameCorner[2].Y - frameCorner[0].Y)
                    frameRect = rh.Geometry.Rectangle3d(rh.Geometry.Plane.WorldXY, frameCorner[0], frameCorner[2]).ToNurbsCurve()
                    door = Door.Door(panels, frameRect, rs.GetUserText(doorFrame[doorFrameId][0],"Room"))
                    self.m_doors.append(door)
            
        #make way for entry
        for (epObject,ep) in zip(entryPointObject,curEntries):
            gridEpX = int(math.floor((ep.pos.X - gridStartX)/self.gridSize))
            gridEpY = int(math.floor((gridStartY - ep.pos.Y)/self.gridSize))
            
            curGrids[gridEpX][gridEpY] = STATE_ENTRY
            epGroupList = epObject.GetGroupList()
            dir = rs.GetUserText(epObject,"Direction")
            checker = 5
            if dir == "LEFT":
                for i in range(-1,-checker,-1):
                    if curGrids[gridEpX + i][gridEpY] == STATE_BLOCKED:
                        curGrids[gridEpX + i][gridEpY] = STATE_FREE
                    elif curGrids[gridEpX + i][gridEpY] == STATE_FREE:
                        break
            elif dir == "RIGHT":
                for i in range(1,checker):
                    if curGrids[gridEpX + i][gridEpY] == STATE_BLOCKED:
                        curGrids[gridEpX + i][gridEpY] = STATE_FREE
                    elif curGrids[gridEpX + i][gridEpY] == STATE_FREE:
                        break
            elif dir == "UP":
                for i in range(-1,-checker,-1):
                    if curGrids[gridEpX][gridEpY + i] == STATE_BLOCKED:
                        curGrids[gridEpX][gridEpY + i] = STATE_FREE
                    elif curGrids[gridEpX][gridEpY + i] == STATE_FREE:
                        break
            elif dir == "DOWN":
                for i in range(1,checker):
                    if curGrids[gridEpX][gridEpY + i] == STATE_BLOCKED:
                        curGrids[gridEpX][gridEpY + i] = STATE_FREE
                    elif curGrids[gridEpX][gridEpY + i] == STATE_FREE:
                        break
            for (tObject,target) in zip(targetPointObject,curTargets):
                #entrypoint and targetpoint is similar
                if epObject.Geometry.Location == tObject.Geometry.Location:
                    ep.target = target
                    break
                    
                #entrypoint different with targetpoint
                targetGroupList = tObject.GetGroupList()
                counter = 0
                #target and entry point must have all their group similar
                if targetGroupList == None or epGroupList == None:
                    continue
                for tGroup in targetGroupList:
                    for eGroup in epGroupList:
                        if tGroup == eGroup:
                            counter +=1
                            break
                if counter == len(targetGroupList):
                    ep.target = target
                    break
        
        #calculate additional weight, to make agent not walk to close with object or wall
        for i in range(len(curGrids[0])):
            for j in range(len(curGrids)):
                for neighbor in self.NEIGHBOR_CHECK:
                    toCheckX = i + neighbor[0]
                    toCheckY = j + neighbor[1]
                    
                    #out of area
                    if (toCheckX < 0) or (toCheckX >= gridCountH) or (toCheckY < 0) or (toCheckY >= gridCountW):
                        continue
                    
                    #wall
                    if curGrids[j][i] == STATE_BLOCKED:
                        continue
                    
                    if curGrids[toCheckY][toCheckX] == STATE_BLOCKED:
                        curAdditionalWeight[j][i] = max(curAdditionalWeight[j][i],(self.NEIGHBOR_DIS - max(abs(neighbor[0]),abs(neighbor[1])) + 1) * self.gridSize * 100)
        
        for (tObject,target) in zip(targetPointObject,curTargets):
            targetGroupList = tObject.GetGroupList()
            for room in self.m_rooms:
                if room.CheckAndAddItem(target):
                    break
            if targetGroupList == None:
                continue
                
        entryToRemove = []
        for entry in curEntries:
            print entry.pos
            if entry.target != None:
                print entry.target.m_id
            ids = entry.target.m_id.split(";")
            if len(ids) > 1:
                for id in ids:
                    nTarget = entry.target.CreateCopyForId(id)
                    nEntry = entry.CreateCopyForTarget(nTarget)
                    curEntries.append(nEntry)
                    curTargets.append(nTarget)
                entryToRemove.append(entry)
        for entry in entryToRemove:
            curTargets.remove(entry.target)
            curEntries.remove(entry)
        
        self.gridInitialized = True
            
        self.topPos.append(Point3d(gridStartX,gridStartY,0))
        Global.Logger.LogDebug("Grids\n")
        for i in range(len(curGrids[0])):
            s = ""
            for j in range(len(curGrids)):
                s += (str(curGrids[j][i])+" ")
            Global.Logger.LogDebug(s+"\n")
        Global.Logger.DumpDebug(10)
        self.grids.append(curGrids)
        self.additionalWeight.append(curAdditionalWeight)
        self.possibleTarget = self.possibleTarget + curTargets
        self.entryPoint = self.entryPoint + curEntries
        Global.g_myHouse.m_rooms = self.m_rooms
        Global.Logger.DumpDebug()
        
    def LoadLightAndTemperatureTable(self):
        Global.Logger.LogDebug("Load temperature\n")
        tableLight = {}
        tableTemperature = {}
        
        cFPath = ghenv.Component.OnPingDocument().FilePath
        cpath = cFPath[0:cFPath.rfind('\\')+1]
        resPath = cpath+'..\\res\\'+self.m_mapName+'\\'
        
        lightFile = resPath+Config.ROOM_LIGHT_FILE
        
        with open(lightFile) as csvfile:
            reader = csv.reader(csvfile)
            columnTable = []
            for row in reader:
                if row[0] == "Day":
                    for i in range(2,len(row)):
                        columnTable.append(row[i])
                        tableLight[row[i]] = []
                else:
                    for i in range(2,len(row)):
                        tableLight[columnTable[i-2]].append(float(row[i]))
        
        temperatureFile = resPath+Config.ROOM_TEMPERATURE_FILE
        with open(temperatureFile) as csvfile:
            reader = csv.reader(csvfile)
            columnTable = []
            for row in reader:
                if row[0] == "Day":
                    for i in range(2,len(row)):
                        columnTable.append(row[i])
                        tableTemperature[row[i]] = []
                else:
                    for i in range(2,len(row)):
                        tableTemperature[columnTable[i-2]].append(float(row[i]))
        
        Global.Logger.LogDebug("table light "+str(tableLight.keys())+"\n")
        Global.Logger.DumpDebug(10)
        for room in self.m_rooms:
            usedLightTable = []
            if room.m_name in tableLight.keys():
                usedLightTable = tableLight[room.m_name]
            usedTableTemperature = []
            if room.m_name in tableTemperature.keys():
                usedTableTemperature = tableTemperature[room.m_name]
            room.SetLightAndTemperatureTable(usedLightTable, usedTableTemperature)
        
    def DetermineRotationCenterAndDir(self, frameBox, panel):
        panelBox = panel.Geometry.GetBoundingBox(True)
        panelCenter = panelBox.Center
        
        frameCenter = frameBox.Center
        
        panelCorner = panelBox.GetCorners()
        isPanelVertical = (panelCorner[2].X - panelCorner[0].X < panelCorner[2].Y - panelCorner[0].Y)
        index = 0
        direction = DIRECTION_CCW
        if isPanelVertical:
            if frameCenter.X > panelCenter.X:
                if frameCenter.Y > panelCenter.Y:
                    index = 3
                else:
                    index = 0
                    direction = DIRECTION_CW
            else:
                if frameCenter.Y > panelCenter.Y:
                    index = 2
                    direction = DIRECTION_CW
                else:
                    index = 1
        else:
            if frameCenter.X > panelCenter.X:
                if frameCenter.Y > panelCenter.Y:
                    index = 1
                    direction = DIRECTION_CW
                else:
                    index = 2
            else:
                if frameCenter.Y > panelCenter.Y:
                    index = 0
                else:
                    index = 3
                    direction = DIRECTION_CW
        rotationCenter = panelCorner[index]
        
        if isPanelVertical:
            if index == 0 or index == 3:
                rotationCenter.X += OFFSET
            else:
                rotationCenter.X -= OFFSET
        else:
            if index == 0 or index == 1:
                rotationCenter.Y += OFFSET
            else:
                rotationCenter.Y -= OFFSET
        return rotationCenter, direction
        
    def RunScript(self,reset, area, mapName):
        self.m_mapName = mapName
        gridArea = None
        topPos = None
        entryPoints = None
       
        
        __author__ = "andri.setiawan"
        __version__ = "2020.03.16"
        
        import rhinoscriptsyntax as rs
        import sys
        
        print reset
        if reset:
            self.gridInitialized = False
            self.isRun = False
            return None,None,None
        
        if (not self.isRun) and (not reset):
            self.isRun = True
            self.grids = []
            self.gridInitialized = False
            self.topPos = []
            self.possibleTarget = []
            self.entryPoint = []
            
        if not self.gridInitialized:
            self.m_mapName = mapName
            self.m_rooms = []
            Global.Logger.LogDebug("init\n")
            PathFinding.Map.actualRect = []
            for (idx,floor) in enumerate(area):
                Global.Logger.LogDebug("init "+str(idx)+" "+str(floor)+"\n")
                self.InitializeGrid(floor,idx)
                curveFloor = rs.coercecurve(floor)
                PathFinding.Map.actualRect.append(curveFloor)
            PathFinding.Map.InitNode()
            for target in self.possibleTarget:
                Global.Logger.LogDebug( "target floor "+str(target.m_targetPoint)+" "+str(target.m_floorIndex) +"\n")
            Global.Logger.DumpDebug()
            sc.sticky["PossibleTarget"] = self.possibleTarget
            sc.sticky["EntryPoint"] = self.entryPoint
            Global.g_myHouse.m_doors = self.m_doors

        gridArea = self.grids
        topPos = self.topPos
        additionalWeight = self.additionalWeight
        
        return gridArea,topPos,additionalWeight,self.m_rooms
        return None, None, None, None
# ---------- end gridgenerator ----------
agentgenerator = GhPythonScript(rooms=gridgenerator.rooms, agentPos=python, ActiveAgent=agentactiveform.ActiveAgent, reset=appcontrol)  # -> agentList; inputs rooms: list, agentPos: list, ActiveAgent: list of Boolean, reset: Boolean
# ---------- agentgenerator: Python ----------
from ghpythonlib.componentbase import executingcomponent as component
import Grasshopper, GhPython
import System
import Rhino
import rhinoscriptsyntax as rs
import sys
import itertools
import scriptcontext as sc
from Rhino.Geometry import Point3d

import csv

cFPath = ghenv.Component.OnPingDocument().FilePath
cpath = cFPath[0:cFPath.rfind('\\')+1]
my_path = cpath+'..\source'
if not my_path in sys.path:
    sys.path.append(my_path)

import Agent
Agent = reload(Agent)
import Activity
Activity = reload(Activity)
import Global

class MyComponent(component):
    def __init__(self):
        self.m_isRun = False
        self.m_agentList = None
        self.m_isAgentInitialized = False
        
    def InitalizeAgent(self, agentPos, ActiveAgent):
        self.m_agentList = []
        for index,pos in enumerate(agentPos):
            if index < len(agentPos) and ActiveAgent[index]:
                tState = Agent.STATE_IDLE
                role = rs.GetUserText(pos,"Role")
                agent = Agent.Agent(pos.PointGeometry.Location,Point3d(0,0,0),index,role,Agent.STATE_IDLE)
                agent.m_active = ActiveAgent[index]
                self.m_agentList.append(agent)
        self.m_isAgentInitialized = True
        
    def RunScript(self, rooms, agentPos, ActiveAgent, reset):
        if reset:
            self.m_isAgentInitialized = False
            return None
            
        if (not self.m_isRun) and (not reset):
            self.m_isRun = True
            self.m_agentList = None
            
        if not self.m_isAgentInitialized:
            Global.g_timer.ResetTimer()
            Global.g_myHouse.ResetEnergyUsage()
            Activity.LoadMultiAgent()
            self.InitalizeAgent(agentPos, ActiveAgent)
            for agent in Agent.Agent.agentList:
                print agent.m_socialValue
        """Provides a scripting component.
            Inputs:
                x: The x script variable
                y: The y script variable
            Output:
                a: The a output variable"""
        
        __author__ = "remote"
        __version__ = "2020.03.24"
        
        import rhinoscriptsyntax as rs
        
        # return outputs if you have them; here I try it for you:
        return self.m_agentList
# ---------- end agentgenerator ----------

# ---- group: Actvity Form
agent_activity_form = GhPythonScript(agent=agentgenerator, reset=appcontrol)  # -> a; inputs agent: list
# ---------- agent_activity_form: Python ----------
from ghpythonlib.componentbase import executingcomponent as component
import Grasshopper, GhPython
import System
import Rhino
import rhinoscriptsyntax as rs
import Rhino.UI
import Eto.Drawing as drawing
import Eto.Forms as forms

import sys
cFPath = ghenv.Component.OnPingDocument().FilePath
cpath = cFPath[0:cFPath.rfind('\\')+1]
my_path = cpath+'..\source'
if not my_path in sys.path:
    sys.path.append(my_path)
    
import Agent
Agent = reload(Agent)
import Global
import Common


class ActivityViewer(forms.Form):
    def __init__(self):
        self.m_agentList = None
        self.Title = "Agent Activity"
        self.Padding = drawing.Padding(10)
        
        self.layout = forms.DynamicLayout()
        self.layout.Spacing = drawing.Size(5,5)
        self.layout.Padding = drawing.Padding(10)
        nLabel = forms.Label()
        
        self.layout.AddRow(nLabel)
        
        self.Content = self.layout
        
    def SetAgent(self, agentList):
        self.m_agentList = agentList
    
    def SetupLayout(self):
        self.m_timeText = forms.Label(Text = "Day "+str(Global.g_timer.GetDay())+" at "+Global.g_timer.GetFormattedHour())
        self.layout.AddRow(self.m_timeText)
        self.m_agentText = []
        for agent in self.m_agentList:
            agentText = agent.m_role + " : "
            if agent.m_currentActivity != None:
                agentText += agent.m_currentActivity.m_ID+" - "+agent.m_currentActivity.m_description
            else:
                agentText += "No Activity"
            textLabel = forms.Label(Text = agentText)
            self.layout.AddRow(textLabel)
            self.m_agentText.append(textLabel)
        header = ["Resource", "Last Usage", "Last User", "Device", "User Activity", "Total"]
        self.m_resGrid = forms.GridView()
        for i in range(len(header)):
            column = forms.GridColumn()
            column.HeaderText = header[i]
            column.DataCell = forms.TextBoxCell(i)
            self.m_resGrid.Columns.Add(column)
            self.m_resGrid.Columns[i].Visible = True
        
        data = []
        res = [["Electricity", Common.ENERGY_TYPE_ELECTRICITY], ["Water", Common.ENERGY_TYPE_WATER], ["Gas", Common.ENERGY_TYPE_GAS]]
        for resArr in res:
            rowData = [resArr[0]]
            hData = Global.g_myHouse.GetLastUsage(resArr[1])
            rowData.extend(hData)
            data.append(rowData)
        self.m_resGrid.DataStore = data
        self.layout.AddRow(self.m_resGrid)
        self.Content = self.layout
        
    def UpdateForm(self):
        self.m_timeText.Text = "Day "+str(Global.g_timer.GetDay())+" at "+Global.g_timer.GetFormattedHour()
        for i in range(0, len(self.m_agentText)):
            agentText = self.m_agentList[i].m_role + " : "
            if self.m_agentList[i].m_currentActivity != None:
                agentText += self.m_agentList[i].m_currentActivity.m_ID+" - "+self.m_agentList[i].m_currentActivity.m_description
            else:
                agentText += "No Activity"
            self.m_agentText[i].Text = agentText
        res = [["Electricity", Common.ENERGY_TYPE_ELECTRICITY], ["Water", Common.ENERGY_TYPE_WATER], ["Gas", Common.ENERGY_TYPE_GAS]]
        data = []
        for resArr in res:
            rowData = [resArr[0]]
            hData = Global.g_myHouse.GetLastUsage(resArr[1])
            rowData.extend(hData)
            data.append(rowData)
        self.m_resGrid.DataStore = data
    
class MyComponent(component):
    def __init__(self):
        self.m_formCreated = False
        self.m_formShown = False
        self.m_form = None
    
    def RunScript(self, agent, reset):
        """Provides a scripting component.
            Inputs:
                x: The x script variable
                y: The y script variable
            Output:
                a: The a output variable"""
        
        if reset:
            self.m_formCreated = False
            self.m_formShown = False
            if self.m_form != None:
                self.m_form.Close()
                self.m_form = None
            return None
        
        print str(self.m_formCreated)+" "+str(self.m_formShown)
        if not self.m_formCreated:
            self.m_form = ActivityViewer()
            self.m_form.SetAgent(agent)
            self.m_form.SetupLayout()
            self.m_form.UpdateForm()
            self.m_form.Show()
            self.m_formShown = True
            self.m_formCreated = True
        
        if self.m_formShown:
            self.m_form.UpdateForm()
        
        __author__ = "LENOVO"
        __version__ = "2022.06.07"
        
        import rhinoscriptsyntax as rs
        a = 0
        
        # return outputs if you have them; here I try it for you:
        return a
# ---------- end agent_activity_form ----------

# ---- group: ABM Updater
abmupdater = GhPythonScript(
    deltaTime=c_script.deltaTime,
    boundArea=python_2.area,
    mArea=gridgenerator.gridArea,
    topPos=gridgenerator.topPos,
    additionalWeight=gridgenerator.additionalWeight,
    agent=agentgenerator,
    scaleSpeed=Slider(4, range=0.5..4))  # -> agentList, location, angle; inputs boundArea: list, mArea: list, topPos: list of Point3d, additionalWeight: list, agent: list
# ---------- abmupdater: Python ----------
from ghpythonlib.componentbase import executingcomponent as component
import Grasshopper, GhPython
import System
import Rhino
import rhinoscriptsyntax as rs
import sys
from Rhino.Geometry import Point3d,Vector3f,Vector3d,Line,Polyline
import math
import scriptcontext as sc

import time

cFPath = ghenv.Component.OnPingDocument().FilePath
cpath = cFPath[0:cFPath.rfind('\\')+1]
my_path = cpath+'..\source'
if not my_path in sys.path:
    sys.path.append(my_path)

import Agent
Agent = reload(Agent)

import PathFinding
PathFinding = reload(PathFinding)

import Global

class MyComponent(component):
    def __init__(self):
        self.haveAgentList = False
        self.myAgent = None
        self.pointScreen = []
        self.m_lastReport = 0
        self.m_frameCount = 0
        self.m_frameEndCount = 0
        self.m_lastTime = 0
    
    def RunScript(self,deltaTime,boundArea, mArea,topPos,additionalWeight, agent, scaleSpeed):
        self.TimeLogStart()
        timeRS1 = int(time.time()*1000)
        import Agent
        
        PathFinding.Map.topPos = topPos
        PathFinding.Map.additionalWeight = additionalWeight
        angle = []
        
        self.ProfileTime("Prepare")
        #there is no agent
        if not agent[0]:
            self.pointScreen = []
            self.myAgent = []
            PathFinding.Map.liveBlock = []
            self.m_frameCount = 0
            self.m_frameEndCount = 0
            self.ProfileTime("Inactive")
            return
        elif len(self.pointScreen) == 0:
            for i in range(len(agent)):
                point = Point3d(0,0,0)
                self.pointScreen.append(point)
                PathFinding.Map.liveBlock.append(((0,0),0))
            self.ProfileTime("Block")
        a = None
        Agent.Agent.s_scaleSpeed = scaleSpeed
        """Provides a scripting component.
            Inputs:
                x: The x script variable
                y: The y script variable
            Output:
                a: The a output variable"""
        if self.m_frameEndCount != self.m_frameCount:
            Global.Logger.LogDebug("Problem at frame "+str(self.m_frameEndCount)+"\n")
            self.m_frameEndCount = self.m_frameCount
        self.m_frameCount += 1
        Global.Logger.LogDebug("Starting frame "+str(self.m_frameCount)+"\n")
        Agent.Agent.agentList = agent
        if not self.myAgent:
            self.myAgent = agent
            Agent.Agent.s_possibleTarget = sc.sticky["PossibleTarget"]
            Agent.Agent.s_entryPointList = sc.sticky["EntryPoint"]
            sc.sticky["StartFrame"] = int(time.time()*1000)
            deltaTime = 0
            Agent.LoadSocialization()
            self.ProfileTime("Load")
        PathFinding.Map.maze = mArea
        
        __author__ = "andri.setiawan"
        __version__ = "2020.03.21"
        
        import rhinoscriptsyntax as rs
        
        Global.g_timer.Update(deltaTime)
        Global.g_myHouse.UpdateHouse()
        Global.Logger.LogDebug("CurTime = "+Global.g_timer.GetFormattedHour()+"\n")
        print Global.g_timer.GetFormattedHour()
        curHour = Global.g_timer.GetHour()
        self.ProfileTime("House/Timer")
        if curHour != self.m_lastReport:
            self.m_lastReport = curHour
            Global.Logger.LogDebug("Call for report\nResource:\n")
            Global.g_myHouse.ReportResource()
            Global.Logger.LogDebug("Energy Usage:\n")
            Global.g_myHouse.ReportEnergyUsage()
            self.ProfileTime("HourlyReport")
        for (i,agt) in enumerate(self.myAgent):
                #print "ini "+str(i)
            timeRS12 = int(time.time()*1000)
            pos = agt.Update(deltaTime)
            timeRS22 = int(time.time()*1000)
            print "update ag "+agt.m_role+" "+str(timeRS22 - timeRS12)
                
            self.pointScreen[i].X = pos.X
            self.pointScreen[i].Y = pos.Y
            self.pointScreen[i].Z = pos.Z
            
            angle.append(math.atan2(agt.moveDir.Y,agt.moveDir.X) - math.atan2(-1,0))
            
        self.ProfileTime("AgentUpdate")
        print("nomura "+str("NumberOfDays" in sc.sticky)+" "+str(Global.g_timer.m_time))
        print("run frame "+str(self.m_frameCount))
        if "NumberOfDays" in sc.sticky:
            print("day "+str(Global.g_timer.GetDay())+" "+str(sc.sticky["NumberOfDays"]))
        if "NumberOfDays" in sc.sticky and Global.g_timer.GetDay() == sc.sticky["NumberOfDays"]:
            Global.g_myHouse.ExportEnergyUsageReport()
            sc.sticky["AgentActivationDone"] = False
            for agent in self.myAgent:
                agent.WriteBioReport()
            self.ProfileTime("EndReport")
        # return outputs if you have them; here I try it for you:
        a = self.pointScreen
        timeRS2 = int(time.time()*1000)
        print str(timeRS2 - sc.sticky["StartFrame"])
        print str(timeRS2 - timeRS1)
        self.m_frameEndCount += 1
        Global.Logger.LogDebug("End frame "+str(self.m_frameEndCount)+"\n")
        self.ProfileTime("EndFrame")
        return self.myAgent,a,angle
        
    def UpdateViewAgent(self,agent):
        t1 = int(time.time()*1000)
        curveBound = agent.curveBoundArea
        
        diagL = agent.diagonalBound
        
        vec1 = rs.VectorRotate(agent.moveDir,-60,(0,0,1))
        #vec1.Unitize()
        endl1 = Point3d.Add(agent.pos,(vec1*diagL))
        mLine1 = Line(agent.pos,endl1)
        
        vec2 = rs.VectorRotate(agent.moveDir,60,(0,0,1))
        endl2 = Point3d.Add(agent.pos,(vec2*diagL))
        mLine2 = Line(agent.pos,endl2)
        
        iSect1 = Rhino.Geometry.Intersect.Intersection.CurveCurve(curveBound,mLine1.ToNurbsCurve(),0,0)
        iSect2 = Rhino.Geometry.Intersect.Intersection.CurveCurve(curveBound,mLine2.ToNurbsCurve(),0,0)
        
        for inte in iSect1:
            point1 = inte.PointA
            
        for inte in iSect2:
            point2 = inte.PointA
        
        vpointList = []
        for poin in curveBound.Points:
            vect = Vector3d.Subtract(Vector3d(poin.Location),Vector3d(agent.pos))
            vect.Unitize()
            angle = math.degrees(math.atan2(vect.Y,vect.X)-math.atan2(vec1.Y,vec1.X))
            if angle >= 0 and angle <= 120:
                vpointList.append((vect,poin.Location))
        
        vpointList.sort(key = lambda x: math.degrees(math.atan2(x[0].Y,x[0].X)-math.atan2(vec1.Y,vec1.X)),reverse = True)
        
        pointList = []
        pointList.append(agent.pos)
        pointList.append(point2)
        for vpoint in vpointList:
            pointList.append(vpoint[1])
        pointList.append(point1)
        pointList.append(agent.pos)
        palo = Polyline(pointList)
        
        t2 = int(time.time()*1000)
        print "delta1 "+str(t2-t1)
        view = sc.doc.Views.ActiveView.ActiveViewport      
        agent.objectList = Rhino.RhinoDoc.ActiveDoc.Objects.FindByCrossingWindowRegion(view,palo,True,Rhino.DocObjects.ObjectType.InstanceReference)
        t3 = int(time.time()*1000)
        print "delta2 "+str(t3-t2)
    
    def TimeLogStart(self):
        self.m_lastTime = int(time.time()*1000)
        
    def ProfileTime(self, part):
        curTime = int(time.time()*1000)
        print("Profile "+part+" "+str(curTime - self.m_lastTime))
        self.m_lastTime = curTime

def TranslateToGridPos(topPos,pos):
    gridX = int(math.ceil((pos.X - topPos.X)/0.1))
    gridY = int(math.ceil((topPos.Y - pos.Y)/0.1))
    return gridX,gridY
# ---------- end abmupdater ----------

# ---- group: Anim Processor
animmanager = GhPythonScript(agents=abmupdater.agentList, location=abmupdater.location, angle=abmupdater.angle)  # -> surface, image; inputs agents: list, location: list of Point3d, angle: list
# ---------- animmanager: Python ----------
from ghpythonlib.componentbase import executingcomponent as component
import Grasshopper, GhPython
import System
import Rhino
import rhinoscriptsyntax as rs
import sys
import math
import time
import scriptcontext as sc
from Rhino.Geometry import Surface,Plane,NurbsSurface,Point3d,Vector3d

cFPath = ghenv.Component.OnPingDocument().FilePath
cpath = cFPath[0:cFPath.rfind('\\')+1]
my_path = cpath+'..\source'
if not my_path in sys.path:
    sys.path.append(my_path)

import Agent
Agent = reload(Agent)

class MyComponent(component):
    def __init__(self):
        self.m_imgPath = []
        self.m_imgPath.append(cpath+'..\\res\\m5.png')
        self.m_imgPath.append(cpath+'..\\res\\w3.png')
        self.m_imgPath.append(cpath+'..\\res\\m4.png')
        self.m_imgPath.append(cpath+'..\\res\\w2.png')
        self.m_imgPath.append(cpath+'..\\res\\m2.png')
        self.m_imgPath.append(cpath+'..\\res\\w1.png')
        self.m_imgPath.append(cpath+'..\\res\\m6.png')
        self.m_imgPath.append(cpath+'..\\res\\w4.png')
        
    def RunScript(self,agents, location,angle):
        """Provides a scripting component.
            Inputs:
                x: The x script variable
                y: The y script variable
            Output:
                a: The a output variable"""
        
        __author__ = "andri.setiawan"
        __version__ = "2020.05.11"
        
        import rhinoscriptsyntax as rs
        surfaces = []
        imgPath = []
        halfSize = 0.2
        for i,agent in enumerate(agents):
            if (agent != None) and (agent.m_active):
                sf = NurbsSurface.CreateFromCorners(Point3d(agent.pos.X - halfSize,agent.pos.Y-halfSize,0),Point3d(agent.pos.X+halfSize,agent.pos.Y-halfSize,0),Point3d(agent.pos.X+halfSize,agent.pos.Y+halfSize,0),Point3d(agent.pos.X - halfSize,agent.pos.Y+halfSize,0))
                angle = math.atan2(agent.moveDir.Y,agent.moveDir.X) - math.atan2(-1,0)
                sf.Rotate(angle,Vector3d(0,0,1),agent.pos)
                surfaces.append(sf)
                imgPath.append(self.m_imgPath[i])
        # return outputs if you have them; here I try it for you:
        return surfaces,imgPath
# ---------- end animmanager ----------
previewmat_2 = CustomPreviewMaterials(Geometry=animmanager.surface, DiffuseColor=RGBA(255, 255, 255, 1), DiffuseBitmap=animmanager.image)
