# Grasshopper definition testintersection.ghx (Grasshopper 1.0.7)

rec = Rectangle({Plane=PlaneXY(4.272469872, 1.141705666, 0), Size=Domain2(u=-1.459830789..1.459830789, v=-1.835418322..1.835418322)})
pt = Point(<point referenced from the Rhino model>)
python = GhPythonScript(x=rec, y=pt)  # -> a; inputs y: Point3d
# ---------- python: Python ----------
from ghpythonlib.componentbase import executingcomponent as component
import Grasshopper, GhPython
import System
import Rhino
import rhinoscriptsyntax as rs
from Rhino.Geometry import Point3d,Vector3d

class MyComponent(component):
    
    def RunScript(self, x, y):
        
        """Provides a scripting component.
            Inputs:
                x: The x script variable
                y: The y script variable
            Output:
                a: The a output variable"""
        
        __author__ = "remote"
        __version__ = "2020.05.20"
        
        import rhinoscriptsyntax as rs
        
        rarea = rs.coercecurve(x)
        Rhino.Geometry.Line(
        print rarea.GetType()
        rc,pl = rarea.TryGetPolyline()
        print pl.GetType()
        #Rhino.Geometry.Polyline.
        ad = pl.ToArray()
        print ad
        # return outputs if you have them; here I try it for you:
        return None
# ---------- end python ----------
python_2 = GhPythonScript(x=rec)  # -> a
# ---------- python_2: Python ----------
from ghpythonlib.componentbase import executingcomponent as component
import Grasshopper, GhPython
import System
import Rhino as rh
import rhinoscriptsyntax as rs
import scriptcontext as sc
import Rhino.Geometry

class MyComponent(component):
    
    def RunScript(self, x, y):
        """Provides a scripting component.
            Inputs:
                x: The x script variable
                y: The y script variable
            Output:
                a: The a output variable"""
        
        __author__ = "remote"
        __version__ = "2020.05.19"
        
        import rhinoscriptsyntax as rs
        print x.GetType()
        rarea = rs.coercecurve(x)
        print rarea
        #print pl
        rc,pl = rarea.TryGetPolyline()
        
        view = sc.doc.Views.ActiveView.ActiveViewport            
        objectList = rh.RhinoDoc.ActiveDoc.Objects.FindByCrossingWindowRegion(view,pl,True,rh.DocObjects.ObjectType.Curve)
        
        #print objectList
        for oi in objectList:
            #rg.Intersect.Intersection.CurveCurve(
            #rs.CurveCurveIntersection
            print oi.Id
            #rs.CurveCurveIntersection(
            #iter = []
            iter = rs.CurveCurveIntersection(oi.CurveGeometry,x,0)
            #p = []
            #iter(p)
            if not iter:
                continue
            print iter
            #print p
            #for aa in iter:
                #print aa
            print "bbbbbbbbbbb"
        # return outputs if you have them; here I try it for you:
        return None
# ---------- end python_2 ----------
